# Grasshopper definition trash.ghx (Grasshopper 0.9.76)

c_script = CSharpScript()  # -> out, A
# ---------- c_script: C# ----------
    var m = new List<Brep>();
    double r1 = 100;
    double r2 = 150;
    double h = 400;
    double h1 = 40;
    double h2 = 20;
    double w = 2;



        {
          var pl = new Polyline();
          pl.Add(0, 0, 0);
          pl.Add(r1, 0, 0);
          pl.Add(GetR(r1, r2, h, h1), 0, h1);
          pl.Add(GetR(r1, r2, h, h1) - w, 0, h1);
          pl.Add(r1 - w, 0, w);
          pl.Add(0, 0, w);
          m.Add(Brep.CreateFromRevSurface(RevSurface.Create(pl.ToNurbsCurve(), new Line(0, 0, 0, 0, 0, 1), 0, 2 * Math.PI), false, false));
        }
        {
          var pl = new Polyline();
          pl.Add(r2, 0, h);
          pl.Add(GetR(r1, r2, h, h1), 0, h1);
          pl.Add(GetR(r1, r2, h, h1) - w, 0, h1);
          pl.Add(r2 - w, 0, h);
          pl.Add(r2, 0, h);
          m.Add(Brep.CreateFromRevSurface(RevSurface.Create(pl.ToNurbsCurve(), new Line(0, 0, 0, 0, 0, 1), 0, 2 * Math.PI), false, false));
        }
    {
      var pl = new Polyline();
      pl.Add(r2 + w / 2, 0, h);
      pl.Add(GetR(r1, r2, h, h1) + w / 2, 0, h1);
      pl.Add(GetR(r1, r2, h, h1) + w, 0, h1);
      pl.Add(r2 + w, 0, h);
      pl.Add(r2 + w / 2, 0, h);
      m.Add(Brep.CreateFromRevSurface(RevSurface.Create(pl.ToNurbsCurve(), new Line(0, 0, 0, 0, 0, 1), 0, 2 * Math.PI), false, false));
    }
        {
          var pl = new Polyline();
          pl.Add(GetR(r1, r2, h, h + w) + 2 * w, 0, h + w);
          pl.Add(GetR(r1, r2, h, h + w) - 2 * w, 0, h + w);
          pl.Add(GetR(r1, r2, h, h - h2) - 2 * w, 0, h - h2);
          pl.Add(GetR(r1, r2, h, h - h2) + 2 * w, 0, h - h2);
          pl.Add(GetR(r1, r2, h, h + w) + 2 * w, 0, h + w);
          m.Add(Brep.CreateFromRevSurface(RevSurface.Create(pl.ToNurbsCurve(), new Line(0, 0, 0, 0, 0, 1), 0, 2 * Math.PI), false, false));
        }
    A = m;
# ---------- c_script: C# additional code ----------
  double GetR(double r1, double r2, double h, double harg){
    return r1 + (r2 - r1) * harg / h;
  }
# ---------- end c_script ----------
